% Simulink data dictionary CarDict.sldd

numSurf = 2
pistonArea = 0.65
pressureGain = Simulink.Parameter(10000, Min=100, Max=10000, Unit="Pa")
clutchVeloTolRads = 0.1
rollingRadius = Simulink.Parameter(0.3, Unit="m")
initialVelocity = Simulink.Parameter(20, Unit="m/s")
torqueRadius = 350
clutchPressureTresh = Simulink.Parameter(8000, DataType="double", Min=0, Max=10000, Unit="Pa")